# Grasshopper definition pytorch_logo.gh (Grasshopper 1.0.7)

number_slider = Slider(100, range=0..100)
crv = Curve(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)
crv_2 = Curve(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)
num = Number(reverse([Slider(20, range=0..100), Slider(300, range=-1001..2000)]))
boundary = BoundarySurfaces(Edges=[crv, crv_2])  # -> graft(Surfaces)
popgeo = PopulateGeometry(Geometry=boundary, Count=graft(num), Seed=1)
pt = Point(popgeo)
